# Grasshopper definition metaballTable.gh (Grasshopper 1.0.7)
# plug-ins: Kangaroo2 Components

pt = Point([Point(197.2940778, -46.84548272, 0), Point(268.7103106, 698.2146915, 0), Point(-120.7051652, 412.1640169, 0), Point(-445.0474355, -187.531861, 0), Point(-27.07893304, -482.3370003, 0)])
scale = Panel("0.1")
height = GetNumber(Slider(350, range=350..1000), AtLeast=1, AtMost=2147483647, Maximum=1.797693135e+308, Minimum=-1.797693135e+308)
points = GetPoint(pt, AtLeast=1, AtMost=2147483647, Realtime=True)
dimension = GetNumber(Slider(800, range=350..1000), AtLeast=1, AtMost=2147483647, Maximum=1.797693135e+308, Minimum=-1.797693135e+308)
dom = ConstructDomain(DomainStart=expr("-x/2", dimension), DomainEnd=expr("x/2", dimension))
Z = UnitZ(Factor=height)
rectangle = Rectangle(Plane=PlaneXY(0, 0, 0), XSize=dom, YSize=dom, Radius=0)  # -> Rectangle, Length
move = Move(Geometry=rectangle.Rectangle, Motion=Z)  # -> Geometry, Transform

# ---- group: RH_OUT:limit
crv = Curve(rectangle.Rectangle)

# ----
scale_2 = Scale(Geometry=points, Center=Point(0, 0, 0), Factor=scale)  # -> Geometry, Transform
scale_3 = Scale(Geometry=move.Geometry, Center=Point(0, 0, 0), Factor=scale)  # -> Geometry, Transform
pop2d = Populate2D(Region=scale_3.Geometry, Count="10", Seed=1)
item = ListItem(List=pop2d, Index=0, Wrap=True)
cp = ClosestPoint(Point=scale_2.Geometry, Cloud=pop2d)  # -> ClosestPoint, CPIndex, Distance
pdecon = Deconstruct(Point=item)  # -> XComponent, YComponent, ZComponent
ln = Line(StartPoint=cp.ClosestPoint, EndPoint=scale_2.Geometry)
range = Range(Domain=pdecon.ZComponent, Steps=Slider(17, range=5..25))
ext = ExtendCurve(Curve=ln, Type=0, Start="0", End="10")
item_2 = ListItem(List=reverse(range), Index=0, Wrap=True)
divide = DivideCurve(Curve=ext, Count=10, Kinks=False)  # -> flatten(Points), Tangents, Parameters
lng = ListLength(List=divide.Points)
dup = DuplicateData(Data=Slider(39.123, range=0..100), Number="10", Order=True)
dup_2 = DuplicateData(Data=Slider(2.212, range=0..100), Number=lng, Order=True)
pt_2 = ConstructPoint(XCoordinate=0, YCoordinate=0, ZCoordinate=range)
bool = Boolean(lng)
merge = Merge(Data1=flatten(divide.Points), Data2=flatten(pop2d))
merge_2 = Merge(Data1=dup_2, Data2=dup)
filter = StreamFilter(Gate=bool, Stream1=merge_2)
metaball_t = MetaBallTCustom(Points=merge, Charge=filter, Plane=pt_2, Threshold=Slider(0.506, range=0..1))
scale_4 = Scale(Geometry=metaball_t, Center=Point(0, 0, 0), Factor="10")  # -> Geometry, Transform
crv_2 = Curve(simplify(scale_4.Geometry))
explode = Explode(Curve=crv_2, Recursive=True)  # -> flatten(Segments), Vertices
dupln = RemoveDuplicateLines(Lines=explode.Segments, Tolerance=0.01)
join = JoinCurves(Curves=dupln, Preserve=False)
redpline = Reduce(Polyline=join, Tolerance=1)  # -> Polyline, Reduction
midpt = CurveMiddle(Curve=redpline.Polyline)
pdecon_2 = Deconstruct(Point=midpt)  # -> XComponent, YComponent, ZComponent
bnd = Bounds(Numbers=pdecon_2.ZComponent)
unit_z = UnitZ(Factor=Slider(30, range=0..10000))
dedomain = DeconstructDomain(Domain=bnd)  # -> Start, End
gradient = Gradient(
    LowerLimit=0,
    UpperLimit=dedomain.End,
    Parameter=pdecon_2.ZComponent,
    stops=[0.125: RGB(0, 0, 0), 0.499: RGB(255, 251, 0), 0.868: RGB(255, 0, 255)])
extrude = Extrude(Base=redpline.Polyline, Direction=unit_z)
mesh = MeshBrep(
    Brep=extrude,
    Settings={GridMaxCount=0, GridMinCount=16, JaggedSeams=False, MaxEdgeLength=0, MinEdgeLength=0.0001, MinTolerance=0, Refine=True, RefineAngle=0, RelativeTolerance=0.65, SimplePlanes=True, Tolerance=0})
c_script = CSharpScript(crv=redpline.Polyline, color=gradient)  # -> out, A; inputs crv: Curve, color: Color
# ---------- c_script: C# ----------
    var c = color.R + "," + color.G + "," + color.B;
    crv.SetUserString("color", c);
    A = crv;
# ---------- end c_script ----------
preview = CustomPreview(Geometry=redpline.Polyline, Material=gradient)
brep_edges = BrepEdges(Brep=extrude)  # -> Naked, Interior, NonManifold
custom_preview = CustomPreview(Geometry=extrude, Material=ColourSwatch(SwatchColor=RGB(137, 98, 66)))

# ---- group: RH_OUT:crvs
crv_3 = Curve(c_script.A)
